# Grasshopper definition rough_cut.gh (Grasshopper 1.0.7)

# ----
# Set cut speed:
cut_speed = Slider(995, range=200..2000)

# ----
# Set Z axis safe offset:
z_safe_mm = Slider(10, range=1..10)

# ----
# Select your tool diameter:
list = ValueList({"1/4''": 6.35, "1/8''": 3.175, "6mm": 6, "8mm": 8}, selected="8mm")

# ----
# Set offset between layers:
offset = Slider(3, range=1..6)

# ----
# Set overlap (suggested 50%):
overlap = Slider(50, range=10..90)

# ----
# Change to save if you want to save:
save_toggle = ValueList({"Save": True, "Don't Save": False}, selected="Don't Save")

# ----
# Rough Cut Program
# Select your design:
# Right click on 'Brep'->Set One Brep
brep = Brep(<brep referenced from the Rhino model>)

program = Program(brep=brep, overlap=overlap, diameter=list, offset=offset, zsafe=z_safe_mm, save=save_toggle, cut_speed=cut_speed)
# connection line on bowl edge
crv = Curve(program)

# ==== cluster Program
brep = ClusterInput()  # Input Brep
diameter = ClusterInput()
overlap = ClusterInput()
offset = ClusterInput()  # How many cm to keep
zsafe = ClusterInput()

# ----
# For Sharan
save = ClusterInput()
# header for
# hybrid lab
# shopbot machine
# end of Gcode
#  for hybrid lab
# shopbot machine
cut_speed = ClusterInput()  # Cut Speed
# 'SHOPBOT ROUTER FILE IN INCHES
# 'GENERATED BY  SHARANISM Using Grasshopper
# 'Home X = 0.000000 Home Y = 0.000000 Home Z = 0.500000
# 'Rapid clearance gap or Safe Z = 0.500
# 'UNITS:Inches
# '
# IF %(25)=1 THEN GOTO UNIT_ERROR	'check to see software is set to standard
# SA                             	'Set program to absolute coordinate mode
# CN, 90
# 'New Path
# 'Toolpath Name = Finishing Toolpath  - Top
# 'Tool Name   = Ball Nose (0.117 inch)  1/8
# '
# &PWSafeZ = 0.500 	'<<<<<<<<<<<<<<< adjust in GH <<<<<<<<<<<
# &PWMaterial = 0.320	'<<<<<<<<<<<<<<< adjust in GH <<<<<<<<<<<
# '&ToolName = "Ball Nose (0.117 inch)"
# &Tool =1           'Tool number to change to
# C9                   'Change tool
# TR,12000               'Set spindle RPM
# C6                   'Spindle on
# PAUSE 2
# '
# MS,0.8,0.8  			'###sets move speed like feed rate in this case inch/sec 1st argument is xy speed the 2nd is z speed
# '### next 3 lines is move to starting point
# JZ,0.500000			'###jog Z  <<<<<<<<<<<<<<< adjust in GH <<<<<<<<<<<
# J2,0.000000,0.000000		'###Jog 2D <<<<<<<<<<<<<<< adjust in GH <<<<<<<<<<<
# JZ,0.500000
# J2,0.000000,0.000000
# '
# 'Turning router OFF
# C7
# END
# '
# '
# UNIT_ERROR:
# CN, 91                            'Run file explaining unit error
# END
panel = Panel("(horizontal roughing)")
curve = ClusterOutput()  # Curve

create_points = CreatePoints(brep=brep, overlap=overlap, diameter=diameter, offset=offset, zsafe=zsafe)

# ==== cluster CreatePoints
offset = ClusterInput()  # Offset
zsafe = ClusterInput()
brep = ClusterInput()  # Brep
overlap = ClusterInput()
diameter = ClusterInput()

# ----
# Bounding Box
bbox = BoundingBox(Content=brep, Plane=PlaneXY(0, 0, 0))  # -> Box, Box_2
debrep = DeconstructBrep(Brep=bbox.Box)  # -> Faces, Edges, Vertices
bb_y_width = ListItem(List=debrep.Edges, Index=expr("3", 0), Wrap=True)
bb_height = ListItem(List=debrep.Edges, Index=8, Wrap=True)
bb_x_width = ListItem(List=debrep.Edges, Index=2, Wrap=True)
bb_top_plane = ListItem(List=debrep.Faces, Index=5, Wrap=True)

# ----
# Calculate layers amount
min_pt_dis_cm = Slider(0.2, range=0.1..1.1)
len = Length(Curve=bb_height)
python = GhPythonScript(box_length=len, min_pt_dis=min_pt_dis_cm, offset=offset)  # -> a
# ---------- python: Python ----------
"""Provides a scripting component.
    Inputs:
        box_length: Bounding box length
        min_pt_dis: Distance from minimum point
        offset: Offset between each step.
    Output:
        a: Number of steps."""

__author__ = "Yitzchak Vaknin"
__version__ = "2020.03.13"

import rhinoscriptsyntax as rs

# Constants:
DEFAULT_Y_PERCENT = 20

# if min_pt_dis value is greater than box_length
# the min_pt_dis value set to 20 percent of the box_length.  
if min_pt_dis > box_length:
    min_pt_dis = box_length * (DEFAULT_Y_PERCENT / 100)

a = round((box_length - min_pt_dis) / offset)
print(box_length)
# ---------- end python ----------

# ----
# Direction
Z = UnitZ(Factor=offset)
rev = Reverse(Vector=Z)

# ----
# Calculate Z safe
area = Area(Geometry=bb_top_plane)  # -> Area, Centroid
devec = DeconstructVector(Vector=area.Centroid)  # -> XComponent, YComponent, ZComponent
expression = Expression(x=zsafe, y=devec.ZComponent, Expression="(x/10) + y")

arrlinear = LinearArray(Geometry=bb_top_plane, Direction=rev, Count=python)  # -> Geometry, Transform
brep_2 = Brep(brep)

# ----
# Calculate grid parameters
len_2 = Length(Curve=bb_x_width)
len_3 = Length(Curve=bb_y_width)
python_2 = GhPythonScript(diameter=diameter, overlap=overlap, x_box_length=len_2, y_box_length=len_3)  # -> grid_interval, u_div, v_div
# ---------- python_2: Python ----------
"""Provides a scripting component.
    Inputs:
        diameter: millimeter
        overlap: percentage
        x_box_length: bounding box x axis length
        y_box_length: bounding box y axis length
    Output:
        grid_interval: disance between point on grid (cm)
        u_div: divisions in the surfave U direction
        v_div: divisions in the surfave V direction"""

__author__ = "Yitzchak Vaknin"
__version__ = "2020.09.29"

import rhinoscriptsyntax as rs

diameter_in_cm = diameter / 10
grid_interval = diameter_in_cm * (overlap / 100)
u_div = round(x_box_length / grid_interval)
v_div = round(y_box_length / grid_interval)
# ---------- end python_2 ----------
grid = GridStructure(Surface=bb_top_plane, UDivisions=python_2.u_div, VDivisions=python_2.v_div)  # -> StructureLines, StructureNodes

# ----
# Python: extract each layer edges
# C#: convert Python's list of list to a tree
python_3 = GhPythonScript(brep=brep_2, planes_array=arrlinear.Geometry)  # -> edges, flatten(parts); inputs planes_array: list
# ---------- python_3: Python ----------
__author__ = "Yitzchak Vaknin"
__version__ = "2020.09.29"

import rhinoscriptsyntax as rs
import Grasshopper as gh

def main():
    plane_parts = list()
    plane_edges = list()
    planes = planes_array[1:]
    for i in range(len(planes)):
        intersection_result = rs.BooleanIntersection(brep, planes[i], delete_input=False)
        plane_parts.append(intersection_result)
        plane_edges.append(rs.DuplicateEdgeCurves(intersection_result))
    return plane_edges, plane_parts

def listToTree(nestedList):
    """Convert a nested python iterable to a datatree."""
    dt = gh.DataTree[object]()
    for i,l in enumerate(nestedList):
        dt.AddRange(l,gh.Kernel.Data.GH_Path(i))
    return dt

edges, parts = main()
edges = listToTree(edges)
parts = listToTree(parts)
# ---------- end python_3 ----------
c_script = CSharpScript(x=python_3.edges)  # -> A
# ---------- c_script: C# ----------
    A = x;
# ---------- end c_script ----------
viewer = ParamViewer(c_script)

# ----
# Fit ArrayLinear tree depth
# to python's component output
cull_i = CullIndex(List=arrlinear.Geometry, Indices=0, Wrap=True)
flatten = FlattenTree(Tree=cull_i, Path="{0}")  # -> simplify(graft(Tree))
viewer_2 = ParamViewer(flatten)
lng = ListLength(List=viewer_2)

# ----
# Extract relevent
# edges of each step
python_4 = GhPythonScript()  # -> c, b, a; inputs y: list; disabled
# ---------- python_4: Python ----------
"""Provides a scripting component.
    Inputs:
        x: Brep
        y: Cutter planes array
    Output:
        a: List of object's pices
        b: List of splited object's edges
        c: b value as a tree"""

__author__ = "Yitzchak Vaknin"
__version__ = "2020.03.17"

import rhinoscriptsyntax as rs
import Grasshopper as gh

#Constants:
Z_INDEX = 2

def main():
    """Main function"""
    obj = x
    top_plane = y[0]
    planes = y[1:]
    obj_parts = list()
    plane_parts = list()
    for i in range(len(planes)):
        obj_parts.append(filter_obj_breps(rs.SplitBrep(obj, planes[i]), planes[i]))
        plane_parts.append(extract_edges(obj_parts[i], planes[i]))
    return obj_parts, plane_parts

def calc_z_pos(brep):
    """Calculate brep's z position."""
    box = rs.BoundingBox(brep)
    if box:
        return min(box, key=lambda x: x[Z_INDEX])[Z_INDEX]
    else:
        assert()

def filter_obj_breps(breps_list, plane):
    """Return a list of those breps above the plane."""
    filtered_breps = list()
    plane_z = calc_z_pos(plane)
    for brep in breps_list:
        if trim_float(calc_z_pos(brep)) >= plane_z:
            filtered_breps.append(brep)
    return filtered_breps

def trim_float(num):
    """Trim float to a number with 3 digits after point."""
    return float(format(num, '.2f'))

def extract_edges(breps_list, plane):
    """Extract edges with the minimum z value of each cutted brep."""
    temp_list = list()
    for brep in breps_list:
        filtered_edges = filter(lambda x: rs.IsCurveClosed(x), rs.DuplicateEdgeCurves(brep))
        min_z_val = trim_float(calc_z_pos(min(filtered_edges, key=calc_z_pos)))
        for edge in filtered_edges:
            if  trim_float(calc_z_pos(edge)) == min_z_val: temp_list.append(edge)
    return temp_list

def listToTree(nestedList):
    """Convert a nested python iterable to a datatree."""
    dt = gh.DataTree[object]()
    for i,l in enumerate(nestedList):
        dt.AddRange(l,gh.Kernel.Data.GH_Path(i))
    return dt

a, b = main()
b = listToTree(b)
print(a)
#c = b[0]
#b=b[4]
#print(b)
# ---------- end python_4 ----------

# ----
# Debugger
number_slider = Slider(0, range=0..20)
number_slider_2 = Slider(39, range=-400..400)
item = ListItem(Index=number_slider, Wrap=True)
Y = UnitY(Factor=number_slider_2)
move = Move(Geometry=item, Motion=Y)  # -> Geometry, Transform
X = UnitX(Factor=number_slider_2)

# ----
# Filter relevent points
python_5 = GhPythonScript(grid=grid.StructureNodes, brep=brep, plane=flatten)  # -> simplify(a); inputs grid: list
# ---------- python_5: Python ----------
__author__ = "Yitzchak Vaknin"
__version__ = "2020.09.29"

import rhinoscriptsyntax as rs

Z_INDEX = 2

def trim_float(num):
    """Trim float to a number with 3 digits after point."""
    return float(format(num, '.3f'))

def main():
    res = list()
    points = [rs.PointCoordinates(pt) for pt in grid]
    for pt in points:
        prj_plane = rs.ProjectPointToSurface(pt, plane, (0,0,-1))
        prj_brep = rs.ProjectPointToSurface(pt, brep, (0,0,-1))
        if len(prj_brep) == 1 and (trim_float(prj_brep[0][Z_INDEX]) < trim_float(prj_plane[0][Z_INDEX])):
            res.append(prj_plane[0])
    return res

a = main()
# ---------- end python_5 ----------
viewer_3 = ParamViewer(python_5)

# ----
# Remove points that to close to the edges
pull = PullPoint(Point=python_5, Geometry=c_script, ClosestOnly=True)  # -> ClosestPoint, Distance
larger = LargerThan(FirstNumber=pull.Distance, SecondNumber=python_2.grid_interval)  # -> LargerThan, OrEqualTo
cull = CullPattern(List=python_5, CullPattern=larger.OrEqualTo)

# ----
# Create path and returns points list.
# Lines apperas only for debug (use list item to navigate in order)
python_6 = GhPythonScript(grid_interval=python_2.grid_interval, points_lst=cull, z_safe=expression, edges=python_3.edges)  # -> flatten(lines), simplify(points), connected_lines, z_safe_lines; inputs points_lst: list, edges: list
# ---------- python_6: Python ----------
"""Provides a scripting component.
    Inputs:
        grid_interval: The distance between 2 points on the grid.
        points_lst: Relevent points
        z_safe: z safe value
    Output:
        points: Points on path
        lines: main lines
        connected_lines: lines between main lines with same z value 
        z_safe_lines: lines connected through z safe"""

__author__ = "Yitzchak Vaknin"
__version__ = "2020.04.21"

import rhinoscriptsyntax as rs
from scriptcontext import sticky
import Grasshopper as gh

# Constants:
 
X_INDEX = 0
Y_INDEX = 1

# Globals:
lines_list = list()
z_safe_lines = list()
connected_lines = list()
points_list = list()
tupels_list = list() # accumulate points as tuples - 1 or 2 points in tuple


def connect_through_z_safe(pt1, pt2):
    temp1 = rs.AddPoint((pt1[0], pt1[1], z_safe))
    points_list.append(temp1)
    z_safe_lines.append(rs.AddInterpCurve([pt1, temp1]))
    temp2 = rs.AddPoint((pt2[0], pt2[1], z_safe))
    points_list.append(temp2)
    z_safe_lines.append(rs.AddInterpCurve([temp1, temp2]))
    z_safe_lines.append(rs.AddInterpCurve([temp2, pt2]))


def connect_lines(tpl1, tpl2, lastToLast):
    pt1 = tpl1[0]
    pt2 = tpl2[0]
    if lastToLast:
        if tpl1[1] != None:
            pt1 = tpl1[1]
        if len(tpl2) == 2:
            pt2 = tpl2[1]
    temp_curve = rs.AddInterpCurve([pt1, pt2])
    res = False
    for crv in edges:
        res = rs.CurveCurveIntersection(temp_curve, crv)
        if res: break
    if not res:
        connected_lines.append(temp_curve)
    else:
        connect_through_z_safe(pt1, pt2)


def append_pts_in_order(lastToLast, cur_tuple):
    if lastToLast:
        points_list.append(cur_tuple[1])
        points_list.append(cur_tuple[0])
        return False
    else:
        points_list.append(cur_tuple[0])
        points_list.append(cur_tuple[1])
        return True

def create_start_and_end_lines(is_start):
    pt1 = rs.PointCoordinates(points_lst[0]) if is_start else rs.PointCoordinates(points_lst[len(points_lst) - 1])
    temp1 = rs.AddPoint((pt1[0], pt1[1], z_safe))
    points_list.append(temp1)
    if is_start:
        z_safe_lines.append(rs.AddInterpCurve([temp1, pt1]))
    else:
        z_safe_lines.append(rs.AddInterpCurve([pt1, temp1]))

def create_lines():
    cur_tuple = [] # flag to now if we need to accumulate the first point
    lastToLast = False
    last_tuple = [None, None] # accumulate last curve points
    if len(points_lst): create_start_and_end_lines(True)
    for i in range(len(points_lst) - 1):
        
        pt1 = rs.PointCoordinates(points_lst[i])
        pt2 = rs.PointCoordinates(points_lst[i+1])
        # copmare disatnce bwtween 2 points:
        if abs(pt1[Y_INDEX] - pt2[Y_INDEX]) <= (grid_interval+0.1):
            if not cur_tuple: 
                cur_tuple.append(pt1)
        else:
            if cur_tuple:
                cur_tuple.append(pt1)
                lines_list.append(rs.AddInterpCurve(cur_tuple))
                if last_tuple[0] != None:
                    connect_lines(last_tuple, cur_tuple, lastToLast)
                lastToLast = append_pts_in_order(lastToLast, cur_tuple)
                last_tuple[0], last_tuple[1] = cur_tuple[0], cur_tuple[1]
                cur_tuple = list()
            else:
                if last_tuple[0] != None:
                    connect_lines(last_tuple, [pt1], lastToLast)
                points_list.append(pt1)
                last_tuple = [pt1, None]
    # last line:
    if cur_tuple:
        cur_tuple.append(points_lst[len(points_lst) - 1])
        lines_list.append(rs.AddInterpCurve(cur_tuple))
        if last_tuple[0] != None:
            connect_lines(last_tuple, cur_tuple, lastToLast)
        lastToLast = append_pts_in_order(lastToLast, cur_tuple)
    else:
        if last_tuple[0] != None:
            connect_lines(last_tuple, [pt1], lastToLast)
        points_list.append(pt1)
    if len(points_lst): create_start_and_end_lines(False)
    return points_list, lines_list, connected_lines, z_safe_lines

points, lines, connected_lines, z_safe_lines = create_lines()
# ---------- end python_6 ----------
pt = Point(python_6.points)
lines = Curve(python_6.lines)
z_safe_lines = Curve(python_6.z_safe_lines)
connected_lines = Curve(python_6.connected_lines)
viewer_4 = ParamViewer(python_6.connected_lines)

points = ClusterOutput(python_6.points)
